# Grasshopper definition Links.ghx (Grasshopper 1.0.7)
# plug-ins: Rhino.Inside for Autodesk Revit, Brontosaurus, MetaHopper

model = ModelCategoriesPicker({"Air Terminals": -2008013, "Analysis Display Style": -2000304, "Analysis Results": -2000303, "Areas": -2003200, "Bridge Abutments": -2006130, "Bridge Arches": -2006134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}, selected="Walls": -2000011)
all_documents = AllDocuments()  # -> Projects, Families
model_2 = ModelCategoriesPicker({"Air Terminals": -2008013, "Analysis Display Style": -2000304, "Analysis Results": -2000303, "Areas": -2003200, "Bridge Abutments": -2006130, "Bridge Arches": -2006134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}, selected="Walls": -2000011)
dl = DocumentLinks()
dl_2 = DocumentLinks()
dl_3 = DocumentLinks(Document=all_documents.Projects)
bycategory = CategoryFilter(Categories=model, Inverted=False)
panel = Panel(dl)
panel_2 = Panel(dl_2)
bycategory_2 = CategoryFilter(Categories=model_2, Inverted=False)
elements = DocumentElements(Document=dl_2, Filter=bycategory)
panel_3 = Panel(dl_3)
elements_2 = DocumentElements(Document=dl_3, Filter=bycategory_2)
panel_4 = Panel(elements)
panel_5 = Panel(elements_2)

# ----
# Unit Tests
docinfo = DocumentInfo(AutoUpdate=False, Recursive=False)  # -> DocumentName, DocumentFilePath, Components, Params, _3rdPartyAssemblies
panel_6 = Panel("""Revit Project Document : Links_R19_Linked Model
Revit Project Document : Links_R19_Other Linked Model""")
panel_7 = Panel("""Revit Wall : Wall 1 @ Links_R19_Linked Model
Revit Wall : Wall 1 @ Links_R19_Linked Model
Revit Wall : Wall 1 @ Links_R19_Linked Model
Revit Wall : Wall 1 @ Links_R19_Linked Model
Revit Wall : Wall 1 @ Links_R19_Linked Model
Revit Wall : Wall 1 @ Links_R19_Linked Model""")
panel_8 = Panel(docinfo.Components)
item = ListItem(List=docinfo.Components, Index="0", Wrap=True)
item_2 = ListItem(List=docinfo.Components, Index="2", Wrap=True)
concat = Concatenate(FragmentA="Collect All Linked Documents", FragmentB=item, JoinSeparator=";")
concat_2 = Concatenate(FragmentA="Collect Linked Walls", FragmentB=item_2, JoinSeparator=";")
branch = TreeBranch(Tree=elements, Path="{0;0}", MaintainPaths=True)
assert_list = AssertList(TestName=concat, ExpectedList=panel_6, ActualList=panel)  # -> Result, FailedInfo
assert_list_2 = AssertList(TestName=concat_2, ExpectedList=panel_7, ActualList=branch)  # -> Result, FailedInfo
test_results = Panel([assert_list.Result, assert_list_2.Result])
write_results = GhPythonScript(Results=flatten(test_results))  # inputs Results: list
# ---------- write_results: Python ----------
import rhinoscriptsyntax as rs

test_results = r"{}\{}_Results.txt".format(rs.DocumentPath(), rs.DocumentName().replace("*", ""))
with open(test_results, 'w') as rf:
    for resline in Results:
        rf.write(resline + "\n")
# ---------- end write_results ----------
